# Grasshopper definition assig_2.gh (Grasshopper 1.0.7)

point = Point(<point referenced from the Rhino model>)
point_2 = Point(<point referenced from the Rhino model>)
polygon = Polygon(Plane=point, Radius=Slider(7, range=0..10), Segments=Slider(6, range=0..10), FilletRadius=0)  # -> Polygon, Length
polygon_2 = Polygon(Plane=point_2, Radius=Slider(5, range=0..10), Segments=Slider(4, range=0..10), FilletRadius=0)  # -> Polygon, Length
deconstruct_brep = DeconstructBrep(Brep=polygon.Polygon)  # -> Faces, Edges, Vertices
deconstruct_brep_2 = DeconstructBrep(Brep=polygon_2.Polygon)  # -> Faces, Edges, Vertices
length = Length(Curve=deconstruct_brep.Edges)
length_2 = Length(Curve=deconstruct_brep_2.Edges)
curve_middle = CurveMiddle(Curve=deconstruct_brep.Edges)
curve = Curve(deconstruct_brep_2.Edges)
curve_2 = Curve(deconstruct_brep.Edges)
curve_middle_2 = CurveMiddle(Curve=deconstruct_brep_2.Edges)
boolean_toggle = BooleanToggle(True)
division = Division(A=Slider(1.5, range=0..10), B=length)
division_2 = Division(A=Slider(1, range=0..10), B=length_2)
scale = Scale(Geometry=curve_2, Center=curve_middle, Factor=division)  # -> Geometry, Transform
panel = Panel(division)
addition = Addition(A=Slider(1.4, range=0..10), B=Slider(1, range=0..1))
scale_2 = Scale(Geometry=curve, Center=curve_middle_2, Factor=division_2)  # -> Geometry, Transform
vector_2pt = Vector2Pt(PointA=curve_middle_2, PointB=point_2, Unitize=boolean_toggle)  # -> Vector, Length
vector_2pt_2 = Vector2Pt(PointA=point_2, PointB=curve_middle_2, Unitize=boolean_toggle)  # -> Vector, Length
curve_3 = Curve(polygon_2.Polygon)
amplitude = Amplitude(Vector=vector_2pt.Vector, Amplitude=addition)
extrude = Extrude(Base=scale_2.Geometry, Direction=amplitude)
move = Move(Geometry=extrude, Motion=vector_2pt_2.Vector)  # -> Geometry, Transform
trim_with_regions = TrimWithRegions(Curve=move.Geometry, Regions=curve_3)  # -> Inside, Outside
trim_with_regions_2 = TrimWithRegions(Curve=curve_3, Regions=move.Geometry)  # -> Inside, Outside
curve_4 = Curve(flatten(trim_with_regions_2.Outside))
curve_5 = Curve(flatten(trim_with_regions.Inside))
curve_6 = Curve(trim_with_regions_2.Inside)
curve_7 = Curve(trim_with_regions.Outside)
join_curves = JoinCurves(Curves=[curve_5, curve_4], Preserve=False)
panel_2 = Panel(join_curves)
