# Grasshopper definition assig_2_final.gh (Grasshopper 1.0.7)

point = Point(<point referenced from the Rhino model>)
point_2 = Point(<point referenced from the Rhino model>)
point_3 = Point(<point referenced from the Rhino model>)
polygon = Polygon(Plane=point, Radius=Slider(7, range=0..10), Segments=Slider(6, range=0..10), FilletRadius=0)  # -> Polygon, Length
polygon_2 = Polygon(Plane=point_2, Radius=Slider(41, range=0..60), Segments=Slider(4, range=0..10), FilletRadius=0)  # -> Polygon, Length
polygon_3 = Polygon(Plane=point_3, Radius=Slider(34, range=0..60), Segments=Slider(3, range=0..10), FilletRadius=0)  # -> Polygon, Length
deconstruct_brep = DeconstructBrep(Brep=polygon.Polygon)  # -> Faces, Edges, Vertices
deconstruct_brep_2 = DeconstructBrep(Brep=polygon_2.Polygon)  # -> Faces, Edges, Vertices
deconstruct_brep_3 = DeconstructBrep(Brep=polygon_3.Polygon)  # -> Faces, Edges, Vertices
length = Length(Curve=deconstruct_brep.Edges)
length_2 = Length(Curve=deconstruct_brep_2.Edges)
curve_middle = CurveMiddle(Curve=deconstruct_brep.Edges)
curve = Curve(deconstruct_brep_2.Edges)
curve_2 = Curve(deconstruct_brep.Edges)
curve_middle_2 = CurveMiddle(Curve=deconstruct_brep_2.Edges)
length_3 = Length(Curve=deconstruct_brep_3.Edges)
curve_3 = Curve(deconstruct_brep_3.Edges)
curve_middle_3 = CurveMiddle(Curve=deconstruct_brep_3.Edges)
boolean_toggle = BooleanToggle(True)
division = Division(A=Slider(1.5, range=0..10), B=length)
boolean_toggle_2 = BooleanToggle(True)
division_2 = Division(A=Slider(2.7, range=0..10), B=length_2)
division_3 = Division(A=Slider(2.7, range=0..10), B=length_3)
scale = Scale(Geometry=curve_2, Center=curve_middle, Factor=division)  # -> Geometry, Transform
addition = Addition(A=Slider(12, range=0..20), B=Slider(1, range=0..1))
scale_2 = Scale(Geometry=curve, Center=curve_middle_2, Factor=division_2)  # -> Geometry, Transform
addition_2 = Addition(A=Slider(10, range=0..20), B=Slider(1, range=0..1))
scale_3 = Scale(Geometry=curve_3, Center=curve_middle_3, Factor=division_3)  # -> Geometry, Transform
vector_2pt = Vector2Pt(PointA=curve_middle_2, PointB=point_2, Unitize=boolean_toggle)  # -> Vector, Length
vector_2pt_2 = Vector2Pt(PointA=point_2, PointB=curve_middle_2, Unitize=boolean_toggle)  # -> Vector, Length
vector_2pt_3 = Vector2Pt(PointA=curve_middle_3, PointB=point_3, Unitize=boolean_toggle_2)  # -> Vector, Length
vector_2pt_4 = Vector2Pt(PointA=point_3, PointB=curve_middle_3, Unitize=boolean_toggle_2)  # -> Vector, Length
curve_4 = Curve(polygon_2.Polygon)
curve_5 = Curve(polygon_3.Polygon)
amplitude = Amplitude(Vector=vector_2pt.Vector, Amplitude=addition)
amplitude_2 = Amplitude(Vector=vector_2pt_3.Vector, Amplitude=addition_2)
extrude = Extrude(Base=scale_2.Geometry, Direction=amplitude)
extrude_2 = Extrude(Base=scale_3.Geometry, Direction=amplitude_2)
move = Move(Geometry=extrude, Motion=vector_2pt_2.Vector)  # -> Geometry, Transform
move_2 = Move(Geometry=extrude_2, Motion=vector_2pt_4.Vector)  # -> Geometry, Transform
trim_with_regions = TrimWithRegions(Curve=move.Geometry, Regions=curve_4)  # -> Inside, Outside
trim_with_regions_2 = TrimWithRegions(Curve=curve_4, Regions=move.Geometry)  # -> Inside, Outside
trim_with_regions_3 = TrimWithRegions(Curve=move_2.Geometry, Regions=curve_5)  # -> Inside, Outside
trim_with_regions_4 = TrimWithRegions(Curve=curve_5, Regions=move_2.Geometry)  # -> Inside, Outside
curve_6 = Curve(flatten(trim_with_regions_2.Outside))
curve_7 = Curve(flatten(trim_with_regions.Inside))
curve_8 = Curve(flatten(trim_with_regions_4.Outside))
curve_9 = Curve(flatten(trim_with_regions_3.Inside))
curve_10 = Curve(trim_with_regions_2.Inside)
curve_11 = Curve(trim_with_regions.Outside)
curve_12 = Curve(trim_with_regions_4.Inside)
curve_13 = Curve(trim_with_regions_3.Outside)
join_curves = JoinCurves(Curves=[curve_7, curve_6], Preserve=False)
join_curves_2 = JoinCurves(Curves=[curve_9, curve_8], Preserve=False)
